# Grasshopper definition pipeline.gh (Grasshopper 1.0.7)
# plug-ins: LadybugGrasshopper

distancesourcetodetector = Slider(1003, range=800..1400)  # disabled
distancesourcetopatient = Slider(934.4, range=600..1200)  # disabled
panel = Panel("C://Users//gaozj//Desktop//Angio//SyntheticAngio//save_image//1")  # disabled
planesize = Slider(141, range=0..200)  # disabled
relay = Relay()  # disabled
relay_2 = Relay()  # disabled
configangulation = GhPythonScript(
    positionerPrimaryAngle=relay_2,
    positionerSecondaryAngle=relay,
    distanceSourceToPatient=distancesourcetopatient,
    distanceSourceToDetector=distancesourcetodetector,
    planeSize=planesize,
    filePath=panel)  # -> lightVector, receiveScreenPlane, receiveScreen, outFilePath; disabled
# ---------- configangulation: Python ----------
__author__ = "gaozj"
__version__ = "2021.09.14"

import rhinoscriptsyntax as rs
import Rhino
import math
import System

try:
    import scriptcontext as sc
except ImportError as e:  # No Rhino doc is available. This module is useless.
    raise ImportError("Failed to import Rhino scriptcontext.\n{}".format(e))
    
def ConfigAngulation(positionerPrimaryAngle,positionerSecondaryAngle,
    isocenter_x = 8.5, isocenter_y = -10.5, isocenter_z = 50):
    """
    This function sets up  the angulation based on 
    the primary and secondary angles, returns the direction
    where the light comes in and the visualization plane 
    that holds the projection
        Inputs:
            positionerPrimaryAngle: The primary rotation angle
            positionerSecondaryAngle: The secondary rotation angle
        Output:
            lightVector: <Rhino.Geometry.Vector3d> A vector that represents 
                the direction of the X-ray beam
            visualizatioinPlane: <Rhino.Geometry.Plane> A plane object 
                where the receiving screen holds
        """
    isocenter = Rhino.Geometry.Point3d(isocenter_x,isocenter_y,isocenter_z)
    reference_axis = Rhino.Geometry.Point3d(isocenter_x,isocenter_y-1,isocenter_z) - isocenter
    
    ## Primary Rotation Setup
    point_z_plus = Rhino.Geometry.Point3d(isocenter_x,isocenter_y,isocenter_z+1)
    primaryRotationAxis = point_z_plus - isocenter
    #-# Transform Rotation(double angleRadians,Vector3d rotationAxis,Point3d rotationCenter)
    primary_angle_rotation = Rhino.Geometry.Transform.Rotation(math.pi*positionerPrimaryAngle/180, primaryRotationAxis, isocenter)
    reference_axis.Transform(primary_angle_rotation)
    
    ## Construct the YpZ plane with three points
    YpZ_plane = Rhino.Geometry.Plane(isocenter, isocenter + reference_axis, point_z_plus)
    
    ## Secondary Rotation Setup
    secondaryRotationAxis = YpZ_plane.ZAxis
    seconday_angle_rotation = Rhino.Geometry.Transform.Rotation(math.pi*positionerSecondaryAngle/180, secondaryRotationAxis, isocenter)
    reference_axis.Transform(seconday_angle_rotation)
    
    ## Construct Visualzation plane with norm vector and Origin
    ## TODO: Set the X axis direction
    visualizatioinPlane = Rhino.Geometry.Plane(isocenter, reference_axis)
    
    ## The lightVector is on the opposite direction of reference_axis
    lightVector = -reference_axis
    
    #print(visualizatioinPlane) 
    return visualizatioinPlane, lightVector

def offset_plane(plane, distance):
    """Helper function
    Offset the Plane along the Z-axis by certain distance
        Inputs:
            plane: <Rhino.Geometry.Plane> the original plan before offset
            distance: float, the distance where the z axis of plane move along
        Outputs:
            new_plane: <Rhino.Geometry.Plane> the new plane created
    """
    direction_vector = plane.ZAxis*distance
    # print(direction_vector)
    new_origin = plane.Origin + direction_vector
    new_plane = Rhino.Geometry.Plane(new_origin, plane.ZAxis)
    return new_plane

def ConfigreceiveScreen(visualizatioinPlane, distanceSourceToPatient, 
    distanceSourceToDetector, planeSize=150):
    """
    Configure the Receive plane and screen based on the visualization plane, 
    and parameter of distance from the .dcm metadata
    Inputs:
        visualizatioinPlane: <Rhino.Geometry.Plane> A plane object 
            where the receiving screen holds
        distanceSourceToPatient: float, from metadata
        distanceSourceToDetector: float, from metadata
        planeSize: int, the size of a plane
    Output:
        receiveScreenPlane: <Rhino.Geometry.Plane> the plane that receive projection
            of 3D meshes.
        receiveScreen: <Rhino.Geometry.PlaneSurface> the surface that the projections
            lay on.
    """
    # Create receiveScreenPlane
    distanceIsometricToScreen = distanceSourceToPatient - distanceSourceToDetector
    receiveScreenPlane = offset_plane(visualizatioinPlane, distanceIsometricToScreen)
    # Create receiveScreen
    u_interval = Rhino.Geometry.Interval(0, planeSize)
    v_interval = Rhino.Geometry.Interval(0, planeSize)
    receiveScreen = Rhino.Geometry.PlaneSurface(receiveScreenPlane, u_interval, v_interval) 
    motionVector = (receiveScreenPlane.XAxis + receiveScreenPlane.YAxis)* planeSize / 2
    transform = Rhino.Geometry.Transform.Translation(-motionVector)
    receiveScreen.Transform(transform)
    return receiveScreenPlane, receiveScreen

def viewport_by_name(viewName=None):
    """ Helper function
    Get a Rhino Viewport object using the name of the viewport.
    Inputs:
        viewName: Text for the name of the Rhino Viewport. If None, the
            current Rhino viewport will be used. If the view is a named view that
            is not currently open, it will be restored to the active view of
            the Rhino document.
    Output:  
        viewPort: An active viewport of the given name      
    """
    try:
        return sc.doc.Views.Find(viewName, False).ActiveViewport \
            if viewName is not None else sc.doc.Views.ActiveView.ActiveViewport
    except Exception:
        # try to find a named view and restore it
        viewTable = Rhino.RhinoDoc.ActiveDoc.NamedViews
        for i, viewp in enumerate(viewTable):
            if viewp.Name == viewName:
                activeViewport = sc.doc.Views.ActiveView.ActiveViewport
                viewTable.Restore (i, activeViewport)
                return activeViewport
        else:
            raise ValueError('Viewport "{}" was not found in the Rhino '
                             'document.'.format(viewName))

def set_view(lightVector, cameraPosition, cameraUpDirection):
    """ Helper function
    Set the camera position and orientation for Rhino's 'Perspective' viewport 
    Inputs:
        lightVector: <Rhino.Geometry.Vector3d> a vector represents the direction 
            of light 
        cameraPosition: <Rhino.Geometry.Point3d> the point where the camera sits
        cameraUpDirection: <Rhino.Geometry.Vector3d> the direction of camera's up
    Output:  
        viewPort: An active 'Perspective' viewport that has its display mode set
    """
    view_port = viewport_by_name('Perspective')
    view_port.SetCameraTarget(Rhino.Geometry.Point3d.Add(rs.coerce3dpoint(cameraPosition), lightVector), False)
    view_port.SetCameraDirection(lightVector, False)
    view_port.SetCameraLocation(rs.coerce3dpoint(cameraPosition), False)    
    # print(rs.coerce3dpoint(cameraPosition))
    view_port.CameraUp = cameraUpDirection
    return view_port

def CaptureView(filePath, lightVector, receiveScreenPlane, distanceSourceToPatient,
                width=None, height=None, displayMode='Shaded', transparent=True):
    """Capture a Viewport to a PNG file path.

    Args:
        filePath: Full path to the file where the image will be saved.
        lightVector, cameraPosition, cameraUpDirection: see set_view function
        receiveScreenPlane, distanceSourceToPatient: see ConfigreceiveScreen
        width: Integer for the image width in pixels. If None, the width of the
            active viewport will be used. (Default: None).
        height: Integer for the image height in pixels. If None, the height of the
            active viewport will be used. (Default: None).
        displayMode: Text for the display mode to which the Rhino viewport will be
            set. For example: Wireframe, Shaded, Rendered, etc. If None, it will
            be the current viewport's display mode. (Default: Shaded).
        transparent: Boolean to note whether the background of the image should be
            transparent or have the same color as the Rhino scene. (Default: True).

    Returns:
        Full path to the image file that was written.
    """
    # Set the 'Perspective' viewport
    cameraPosition = receiveScreenPlane.Origin + receiveScreenPlane.ZAxis*distanceSourceToPatient/6
    cameraUpDirection = -receiveScreenPlane.XAxis
    viewport = set_view(lightVector, cameraPosition, cameraUpDirection)

    # create the view capture object
    activeViewport = viewport_by_name()
    imgW = activeViewport.Size.Width if width is None else width
    imgH = activeViewport.Size.Height if height is None else height
    # print(imgW, imgH)
    imgSize = System.Drawing.Size(imgW, imgH)

    # capture the view
    if displayMode is not None:
        modeObj = Rhino.Display.DisplayModeDescription.FindByName(displayMode)
        pic = viewport.ParentView.CaptureToBitmap(imgSize, modeObj)
    else:
        pic = viewport.ParentView.CaptureToBitmap(imgSize)

    # remove the background color if requested
    if transparent:
        backCol = Rhino.ApplicationSettings.AppearanceSettings.ViewportBackgroundColor
        if (displayMode is None and viewport.DisplayMode.EnglishName == 'Rendered') \
                or displayMode == 'Rendered':
            backCol = sc.doc.Views.Document.RenderSettings.BackgroundColorTop
        pic.MakeTransparent(backCol)

    # save the bitmap to a png file
    if not filePath.endswith('.png'):
        filePath = '{}.png'.format(filePath)
    System.Drawing.Bitmap.Save(pic, filePath)
    return filePath
    
visualizatioinPlane, lightVector = ConfigAngulation(positionerPrimaryAngle,positionerSecondaryAngle)

receiveScreenPlane, receiveScreen = ConfigreceiveScreen(visualizatioinPlane, distanceSourceToPatient, 
    distanceSourceToDetector, planeSize)

outFilePath = CaptureView(filePath, lightVector, receiveScreenPlane, distanceSourceToPatient, 1100, 1100)
# ---------- end configangulation ----------
lb_imageviewer = LBImageViewer(ImagePath_=configangulation.outFilePath, _scale_=1, DisableClickable=False, SaveImgWithCoords=False, scale=1)  # -> ImagePath, Values, GIF; disabled
vector = Vector(configangulation.lightVector)  # disabled
surface = Surface(configangulation.receiveScreen)  # disabled
plane = Plane(configangulation.receiveScreenPlane)  # disabled
# Setting up Angulation
multiplication = Multiplication()

plus = Panel("10")
minus = Panel("10")
X = Panel("8.5")
Y = Panel("-10.5")
Z = Panel("50")
positionersecondaryangle = Slider(-12.7, range=-40..40)
positionerprimaryangle = Slider(17, range=-100..60)
addition = Addition(A=Z, B=plus)
addition_2 = Addition(A=Y, B=plus)
subtraction = Subtraction(A=Y, B=minus)
y_direction = ConstructPoint(XCoordinate=X, YCoordinate=addition_2, ZCoordinate=Z)
y_direction_2 = ConstructPoint(XCoordinate=X, YCoordinate=subtraction, ZCoordinate=Z)
adjustable_isocenter = ConstructPoint(XCoordinate=X, YCoordinate=Y, ZCoordinate=Z)
z_direction = ConstructPoint(XCoordinate=X, YCoordinate=Y, ZCoordinate=addition)
radians = Radians(Degrees=positionerprimaryangle)
radians_2 = Radians(Degrees=positionersecondaryangle)
vector_z = Vector2Pt(PointA=adjustable_isocenter, PointB=z_direction, Unitize=False)  # -> Vector, Length
vector_y = Vector2Pt(PointA=adjustable_isocenter, PointB=y_direction, Unitize=False)  # -> Vector, Length
vector_y_2 = Vector2Pt(PointA=adjustable_isocenter, PointB=y_direction_2, Unitize=False)  # -> Vector, Length
isocenter = Point(adjustable_isocenter)
primary_rotate = Rotate(Vector=vector_y_2.Vector, AlongAxis=vector_z.Vector, Angle=radians)
xy_plane = PlaneNormal(Origin=adjustable_isocenter, ZAxis=vector_z.Vector)
xz_plane = PlaneNormal(Origin=adjustable_isocenter, ZAxis=vector_y.Vector)
width = Panel("10")
get_endpoint = Addition(Origin=isocenter, Vector=primary_rotate)
primary_rotation_vector = VectorDisplayEx(Point=adjustable_isocenter, Vector=primary_rotate, Colour=ColourSwatch(SwatchColor=RGB(4, 0, 250)), Width=width)
isocenter_2 = Point(adjustable_isocenter)
ypz_plane = Plane3Pt(PointA=adjustable_isocenter, PointB=get_endpoint, PointC=z_direction)
deconstruct_plane = DeconstructPlane(Plane=ypz_plane)  # -> Origin, XAxis, YAxis, ZAxis
secondary_rotate = Rotate(Vector=primary_rotate, Axis=deconstruct_plane.ZAxis, Angle=radians_2)
colour_swatch = ColourSwatch(SwatchColor=RGB(250, 0, 0))
vector_display = VectorDisplay(Anchor=isocenter, Vector=deconstruct_plane.ZAxis)
visua_plane_origin = PlaneNormal(Origin=isocenter_2, ZAxis=secondary_rotate)
get_endpoint_2 = Addition(Origin=isocenter, Vector=secondary_rotate)
secondary_vector_display = VectorDisplayEx(Point=adjustable_isocenter, Vector=secondary_rotate, Colour=colour_swatch, Width=width)
vector_light = Vector2Pt(PointA=get_endpoint_2, PointB=isocenter_2, Unitize=False)  # -> Vector, Length
# Setting Up Receive Screen
vector_display_ex = VectorDisplayEx(Point=isocenter_2, Vector=multiplication, Colour=colour_swatch, Width=width)  # disabled

panel_2 = Panel(radians)
panel_3 = Panel(radians_2)

effect_region = Slider(0.03, range=0..0.2)
position = Slider(0.52, range=0..1)
severity = Slider(0.73, range=0..1)
boolean_toggle = BooleanToggle(True)
gene_pool = GenePool(Decimals=2, Maximum=1.2, Minimum=0, Value=[0.62, 0.46, 0.45, 0.21])
gene_pool_2 = GenePool(Decimals=2, Maximum=1.2, Minimum=0, Value=[0.75, 0.61, 0.51, 0.21])
gene_pool_3 = GenePool(Decimals=2, Maximum=1, Minimum=0, Value=[0, 0.3, 0.62, 1])
gene_pool_4 = GenePool(Decimals=2, Maximum=1.2, Minimum=0, Value=[0.78, 0.69, 0.51, 0.21])
stnosis_generator = GhPythonScript(stenosis_point=position, effect_region=effect_region, percentage=severity)  # -> positions_param, positions_radii
# ---------- stnosis_generator: Python ----------
__author__ = "gaozj"
__version__ = "2021.09.07"

import rhinoscriptsyntax as rs

baseline_radii = [1.8, 1.6, 1.5, 1.45, 1.4, 1.35, 1.3, 1.25, 1.1, 0.9, 0.7, 0.5, 0.3]

def get_radii(target_point, positions, baseline_radii):
    for index, pos in enumerate(positions):
        if pos <= target_point < positions[index+1]:
            relative_indice = (index, index+1)
            ref_position = positions[index:index+2]
            ref_radii = baseline_radii[index:index+2]
    target_radii = ref_radii[0] - (target_point - ref_position[0])*(ref_radii[0] - ref_radii[1])/(ref_position[1] - ref_position[0])
    return target_radii

def generate_stenosis(baseline_radii, stenosis_point, effect_region, percentage):
    ref_point = len(baseline_radii)
    positions_prep = list(range(0,ref_point,1))
    positions = [round(i/(ref_point-1),2) for i in positions_prep]
    
    stenosis_region_start = stenosis_point - effect_region
    stenosis_region_end = stenosis_point + effect_region
    
    # Obtain the indice of the reference points that fall into the stenosis range
    indice_within_region = []
    # Obtain the indice of the reference points that closest to the stenosis point
    for index, pos in enumerate(positions):
        if stenosis_region_start <= pos <= stenosis_region_end:
            indice_within_region.append(index)
        if pos <= stenosis_point < positions[index+1]:
            stenosis_relative_indices = (index, index+1)
            
    # print(indice_within_region)
    start_radii = round(get_radii(stenosis_region_start, positions, baseline_radii),2)
    stenosis_radii = round((1-percentage)*get_radii(stenosis_point, positions, baseline_radii),2)
    end_radii = round(get_radii(stenosis_region_end, positions, baseline_radii),2)

    if len(indice_within_region) == 0:
        # None of the original reference points fall into the stenosis region, 
        # to create a stenosis, add three additional reference points to the 
        # point list at the position of the stenosis_relative_indices
        ref_index = stenosis_relative_indices[1]
        positions[ref_index:ref_index] = [stenosis_region_start, stenosis_point, stenosis_region_end]   
        baseline_radii[ref_index:ref_index] = [start_radii, stenosis_radii, end_radii]
    else:
        # One or more of the original reference points fall into the stenosis region, 
        # replace them with the stenosis region reference points
        positions[min(indice_within_region):max(indice_within_region)+1] = [stenosis_region_start, stenosis_point, stenosis_region_end]
        baseline_radii[min(indice_within_region):max(indice_within_region)+1] = [start_radii, stenosis_radii, end_radii]
    positions_out = [round(position,2) for position in positions]
    return positions_out, baseline_radii

positions_param, positions_radii = generate_stenosis(baseline_radii, stenosis_point, effect_region, percentage)
# ---------- end stnosis_generator ----------
main_branch = Curve(reparameterize(<curve referenced from the Rhino model>))
curve = Curve(reparameterize(<curve referenced from the Rhino model>))
curve_2 = Curve(reparameterize(<curve referenced from the Rhino model>))
curve_3 = Curve(reparameterize(<curve referenced from the Rhino model>))
curve_4 = Curve(reparameterize(<curve referenced from the Rhino model>))
curve_5 = Curve(reparameterize(<curve referenced from the Rhino model>))
sub_branch_blue = PipeVariable(Curve=curve, Parameters=gene_pool_3, Radii=gene_pool, Caps=boolean_toggle)
sub_branch_green = PipeVariable(Curve=curve_2, Parameters=gene_pool_3, Radii=gene_pool_4, Caps=boolean_toggle)
sub_branch_purple = PipeVariable(Curve=curve_3, Parameters=gene_pool_3, Radii=gene_pool_2, Caps=boolean_toggle)
sub_branch_yellow = PipeVariable(Curve=curve_4, Parameters=gene_pool_3, Radii=gene_pool_2, Caps=boolean_toggle)
sub_branch_light_blue = PipeVariable(Curve=curve_5, Parameters=gene_pool_3, Radii=gene_pool_4, Caps=boolean_toggle)
# Vessels Structures
major_vessel = PipeVariable(
    Curve=main_branch,
    Parameters=stnosis_generator.positions_param,
    Radii=stnosis_generator.positions_radii,
    Caps=boolean_toggle)
split_brep = SplitBrep(Brep=sub_branch_blue, Cutter=major_vessel)
split_brep_2 = SplitBrep(Brep=sub_branch_light_blue, Cutter=major_vessel)
split_brep_3 = SplitBrep(Brep=sub_branch_green, Cutter=major_vessel)
split_brep_4 = SplitBrep(Brep=sub_branch_purple, Cutter=major_vessel)
split_brep_5 = SplitBrep(Brep=sub_branch_yellow, Cutter=major_vessel)
dispatch = Dispatch(List=split_brep, DispatchPattern=[True, False])  # -> ListA, ListB
dispatch_2 = Dispatch(List=split_brep_2, DispatchPattern=[True, False])  # -> ListA, ListB
dispatch_3 = Dispatch(List=split_brep_5, DispatchPattern=[True, False])  # -> ListA, ListB
dispatch_4 = Dispatch(List=split_brep_4, DispatchPattern=[True, False])  # -> ListA, ListB
dispatch_5 = Dispatch(List=split_brep_3, DispatchPattern=[True, False])  # -> ListA, ListB
brep = Brep(dispatch_3.ListA)
brep_2 = Brep(dispatch_2.ListA)
brep_3 = Brep(dispatch_5.ListA)
brep_4 = Brep(dispatch.ListA)
brep_5 = Brep(dispatch_4.ListA)
mesh_brep = MeshBrep(
    Brep=major_vessel,
    Settings={GridMaxCount=0, GridMinCount=16, JaggedSeams=False, MaxEdgeLength=0, MinEdgeLength=0.0001, MinTolerance=0, Refine=True, RefineAngle=0, RelativeTolerance=0.65, SimplePlanes=True, Tolerance=0})
mesh_brep_2 = MeshBrep(
    Brep=brep_5,
    Settings={GridMaxCount=0, GridMinCount=16, JaggedSeams=False, MaxEdgeLength=0, MinEdgeLength=0.0001, MinTolerance=0, Refine=True, RefineAngle=0, RelativeTolerance=0.65, SimplePlanes=True, Tolerance=0})
mesh_brep_3 = MeshBrep(
    Brep=brep_3,
    Settings={GridMaxCount=0, GridMinCount=16, JaggedSeams=False, MaxEdgeLength=0, MinEdgeLength=0.0001, MinTolerance=0, Refine=True, RefineAngle=0, RelativeTolerance=0.65, SimplePlanes=True, Tolerance=0})
mesh_brep_4 = MeshBrep(
    Brep=brep_2,
    Settings={GridMaxCount=0, GridMinCount=16, JaggedSeams=False, MaxEdgeLength=0, MinEdgeLength=0.0001, MinTolerance=0, Refine=True, RefineAngle=0, RelativeTolerance=0.65, SimplePlanes=True, Tolerance=0})
mesh_brep_5 = MeshBrep(
    Brep=brep,
    Settings={GridMaxCount=0, GridMinCount=16, JaggedSeams=False, MaxEdgeLength=0, MinEdgeLength=0.0001, MinTolerance=0, Refine=True, RefineAngle=0, RelativeTolerance=0.65, SimplePlanes=True, Tolerance=0})
mesh_brep_6 = MeshBrep(
    Brep=brep_4,
    Settings={GridMaxCount=0, GridMinCount=16, JaggedSeams=False, MaxEdgeLength=0, MinEdgeLength=0.0001, MinTolerance=0, Refine=True, RefineAngle=0, RelativeTolerance=0.65, SimplePlanes=True, Tolerance=0})
custom_preview = CustomPreview(Geometry=mesh_brep, Material=ColourSwatch(SwatchColor=RGB(242, 31, 105)))
custom_preview_2 = CustomPreview(Geometry=mesh_brep_4, Material=ColourSwatch(SwatchColor=RGB(31, 214, 242)))
custom_preview_3 = CustomPreview(Geometry=mesh_brep_5, Material=ColourSwatch(SwatchColor=RGB(239, 242, 31)))
custom_preview_4 = CustomPreview(Geometry=mesh_brep_2, Material=ColourSwatch(SwatchColor=RGB(179, 31, 242)))
custom_preview_5 = CustomPreview(Geometry=mesh_brep_3, Material=ColourSwatch(SwatchColor=RGB(42, 250, 0)))
custom_preview_6 = CustomPreview(Geometry=mesh_brep_6, Material=ColourSwatch(SwatchColor=RGB(0, 46, 250)))

merge = Merge(Data1=mesh_brep, Data2=mesh_brep_4, Data3=mesh_brep_5, Data4=mesh_brep_2, Data5=mesh_brep_3, Data6=mesh_brep_6)

distancesourcetodetector_2 = Slider(1003, range=800..1400)
distancesourcetopatient_2 = Slider(942.1, range=600..1200)
plane_size = Slider(141, range=0..200)
subtraction_2 = Subtraction(A=distancesourcetopatient_2, B=distancesourcetodetector_2)
receive_plane = PlaneOffset(BasePlane=visua_plane_origin, Offset=subtraction_2)
deconstruct_plane_2 = DeconstructPlane(Plane=receive_plane)  # -> Origin, XAxis, YAxis, ZAxis
uncenter_receive_screen = PlaneSurface(Plane=receive_plane, XSize=plane_size, YSize=plane_size)
receive_screen_center = PolygonCenter(Polyline=uncenter_receive_screen)  # -> CenterV, CenterE, CenterA
line = Line(StartPoint=deconstruct_plane_2.Origin, EndPoint=receive_screen_center.CenterV)
point2vector = Vector2Pt(PointA=receive_screen_center.CenterV, TargetPt=deconstruct_plane_2.Origin, Unitize=False)  # -> Vector, Length
move = Move(Geometry=uncenter_receive_screen, Motion=point2vector.Vector)  # -> Geometry, Transform
colour_swatch_2 = ColourSwatch(SwatchColor=RGB(255, 255, 255))

control_points = ControlPoints(Curve=main_branch)  # -> graft(Points), Weights, Knots
width_2 = Panel("100")
deconstruct = Deconstruct(Point=control_points.Points)  # -> XComponent, YComponent, ZComponent
list_item = ListItem(List=flatten(control_points.Points), Index=Slider(1, range=-1..1), Wrap=True)
multiplication_2 = Multiplication(A=width_2, B=position)
merge_2 = Merge(Data1=deconstruct.XComponent, Data2=deconstruct.YComponent, Data3=deconstruct.ZComponent)
the_first_point = Point(list_item)
integer = Integer(multiplication_2)
panel_4 = Panel(merge_2)
sphere = Sphere(Base=the_first_point, Radius=Slider(0.736, range=0..1))
divide_curve = DivideCurve(Curve=main_branch, Count=width_2, Kinks=False)  # -> Points, Tangents, Parameters
list_item_2 = ListItem(List=divide_curve.Points, Index=integer, Wrap=True)
stnosis_point = Point(list_item_2)
sphere_2 = Sphere(Base=stnosis_point, Radius=Slider(1, range=0..1))
# Mark Important Points
pull_point = PullPoint(Point=divide_curve.Points, Geometry=move.Geometry, ClosestOnly=True)  # -> graft(ClosestPoint), Distance
panel_5 = Panel(pull_point.ClosestPoint)

z_direction_2 = Multiplication(A=deconstruct_plane_2.ZAxis, B=Slider(-1, range=-1..1))
unit_vector = UnitVector(Vector=z_direction_2)
division = Division(A=distancesourcetodetector_2, B=Slider(6, range=1..10))
adjust_vec_cam_d_to_obj = Multiplication(A=division, B=unit_vector)
x_direction = Multiplication(A=deconstruct_plane_2.XAxis, B=Slider(0, range=-1..1))
camera_point = Subtraction(Origin=deconstruct_plane_2.Origin, Vector=adjust_vec_cam_d_to_obj)
# Setting Up Camera
vector_display_2 = VectorDisplay(Anchor=camera_point, Vector=adjust_vec_cam_d_to_obj)
set_view = GhPythonScript(position=camera_point, direction=adjust_vec_cam_d_to_obj, view_name="Perspective", up_direction=x_direction)  # -> out
# ---------- set_view: Python ----------
"""
Reset Rhino's Perspective view based on given Camera location
and veiw direction.
    Inputs:
        view_name: the name of the view
        _position: Rhino 3D point, position of a camera 
        _direction: A Rhino vector that will be used to set the direction of view
    Output:
        out: The name of the view
"""

__author__ = "gaozj"
__version__ = "2021.09.13"

import rhinoscriptsyntax as rs
import Rhino.Geometry as rg
from ladybug_rhino.viewport import viewport_by_name

def set_view(view_name, _direction, _position, _up_direction):
    # import scriptcontext as sc
    # view_port = sc.doc.Views.Find(view_name, False).ActiveViewport
    view_port = viewport_by_name(view_name)
    view_port.SetCameraTarget(rg.Point3d.Add(rs.coerce3dpoint(_position), _direction), False)
    view_port.SetCameraDirection(_direction, False)
    view_port.SetCameraLocation(rs.coerce3dpoint(_position), False)
    view_port.CameraUp = _up_direction
    print(view_name)

set_view(view_name, _direction, _position,_up_direction)
rs.ViewDisplayMode(rs.CurrentView(),"Shaded")

# rs.Command("-_Shade _View=_Active Selected=No DisplayMode=Shaded DrawCurves=No DrawWires=No DrawGrid=No DrawAxes=No _Enter _Enter", True)
#import rhinoscriptsyntax as rs
#import scriptcontext as sc
#import Rhino as rc
#
#sc.doc = rc.RhinoDoc.ActiveDoc
#rs.CurrentView(view = View2Save)
#rs.AddNamedView(ViewName, View2Save)
#sc.doc = ghdoc
# ---------- end set_view ----------
panel_6 = Panel("C://Users//gaozj//Desktop//Angio//SyntheticAngio//save_image//")
run = BooleanToggle(True)
run_2 = BooleanToggle(True)
captureview = LBCaptureView(file_name="Perspective", folder=panel_6, viewport=set_view, transparent=run, capture=run_2)  # -> Output; plug-in component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
lb_imageviewer_2 = LBImageViewer(ImagePath_=captureview, _scale_=1, DisableClickable=False, SaveImgWithCoords=False, scale=1)  # -> ImagePath, Values, GIF

mesh_shadow = MeshShadow(Mesh=mesh_brep, Light=vector_light.Vector, Plane=receive_plane)
mesh_shadow_2 = MeshShadow(Mesh=mesh_brep_4, Light=vector_light.Vector, Plane=receive_plane)
mesh_shadow_3 = MeshShadow(Mesh=mesh_brep_5, Light=vector_light.Vector, Plane=receive_plane)
mesh_shadow_4 = MeshShadow(Mesh=mesh_brep_2, Light=vector_light.Vector, Plane=receive_plane)
mesh_shadow_5 = MeshShadow(Mesh=mesh_brep_3, Light=vector_light.Vector, Plane=receive_plane)
mesh_shadow_6 = MeshShadow(Mesh=mesh_brep_6, Light=vector_light.Vector, Plane=receive_plane)

random_line = Line(line)

curve_6 = Curve(mesh_shadow)
colour_swatch_3 = ColourSwatch(SwatchColor=RGB(0, 0, 0))
gradient_hatch = GradientHatch(Boundaries=curve_6, Axis=random_line, Colour1=colour_swatch_3, Colour2=colour_swatch_3)
contour = Contour(
    Shape=mesh_brep,
    Point=deconstruct_plane_2.Origin,
    Direction=deconstruct_plane_2.ZAxis,
    Distance=Slider(0.15, range=0..8))
colour_swatch_4 = ColourSwatch(SwatchColor=RGBA(0, 0, 0, 14))
pull_to_screen = PullCurve(Curve=contour, Surface=move.Geometry)
gradient_hatch_2 = GradientHatch(Boundaries=pull_to_screen, Axis=random_line, Colour1=colour_swatch_4, Colour2=colour_swatch_4)

panel_7 = Panel(x_direction)
move_2 = Move(Geometry=move.Geometry, Motion=z_direction_2)  # -> Geometry, Transform
# Projection of Vessel Structure on Screen
merge_outlines = Merge(
    Data1=mesh_shadow,
    Data2=mesh_shadow_2,
    Data3=mesh_shadow_3,
    Data4=mesh_shadow_4,
    Data5=mesh_shadow_5,
    Data6=mesh_shadow_6)

gradient_hatch_3 = GradientHatch(Boundaries=move_2.Geometry, Axis=line, Colour1=colour_swatch_2, Colour2=colour_swatch_2)
